# Grasshopper definition firstfacade.gh (Grasshopper 1.0.7)

number_slider = Slider(22, range=0..50)
number_slider_2 = Slider(44, range=0..50)
dom = ConstructDomain(DomainStart=expr("-x", number_slider), DomainEnd=number_slider)
dom_2 = ConstructDomain(DomainStart=expr("-x", number_slider_2), DomainEnd=number_slider_2)
rectangle = Rectangle(Plane=PlaneXY(0, 0, 0), XSize=dom, YSize=dom_2, Radius=0)  # -> Rectangle, Length
number_slider_3 = Slider(50, range=0..50)
crv = Curve([<curve referenced from the Rhino model> x3])
sdivide = DivideSurface(Surface=rectangle.Rectangle, UCount=number_slider_3, VCount=Slider(33, range=0..50))  # -> flatten(Points), Normals, Parameters
pull = PullPoint(Point=sdivide.Points, Geometry=crv, ClosestOnly=True)  # -> ClosestPoint, Distance
min = Minimum(A=pull.Distance, B=Slider(29, range=0..50))
bnd = Bounds(Numbers=min)
dom_3 = ConstructDomain(DomainStart=Slider(14, range=0..50), DomainEnd=Slider(28, range=0..50))
remap = RemapNumbers(Value=min, Source=bnd, Target=dom_3)  # -> Mapped, Clipped
bnd_2 = Bounds(Numbers=min)
Z = UnitZ(Factor=remap.Mapped)
dom_4 = ConstructDomain(DomainStart=Slider(12, range=0..50), DomainEnd=Slider(0, range=0..50))
remap_2 = RemapNumbers(Value=min, Source=bnd_2, Target=dom_4)  # -> Mapped, Clipped
move = Move(Geometry=sdivide.Points, Motion=Z)  # -> Geometry, Transform
X = UnitX(Factor=remap_2.Mapped)
move_2 = Move(Geometry=move.Geometry, Motion=X)  # -> Geometry, Transform
srfgrid = SurfaceFromPoints(Points=move_2.Geometry, UCount=expr("x+1", number_slider_3), Interpolate=False)
divide = DivideDomain²(Domain=srfgrid, UCount=Slider(19, range=0..50), VCount="1")
subsrf = Isotrim(Surface=srfgrid, Domain=divide)
edges = BrepEdges(Brep=subsrf)  # -> Naked, Interior, NonManifold
item = ListItem(List=edges.Naked, Index=0, Wrap=True)  # -> Item, Item1, Item2, Item3
crv_2 = Curve(item.Item)
crv_3 = Curve(item.Item2)
number_slider_4 = Slider(38, range=0..100)
crv_4 = Curve(item.Item1)
crv_5 = Curve(item.Item3)
divide_2 = DivideCurve(Curve=crv_5, Count=number_slider_4, Kinks=False)  # -> reverse(Points), Tangents, Parameters
divide_3 = DivideCurve(Curve=crv_4, Count=number_slider_4, Kinks=False)  # -> Points, Tangents, Parameters
dom_5 = ConstructDomain(DomainStart=Slider(0.705, range=0..1), DomainEnd=Slider(0.767, range=0..1))
ln = Line(StartPoint=divide_3.Points, EndPoint=divide_2.Points)
curvepoint = PointOnCurve(ln, parameter=0.5)
pdecon = Deconstruct(Point=curvepoint)  # -> XComponent, YComponent, ZComponent
bnd_3 = Bounds(Numbers=flatten(pdecon.ZComponent))
remap_3 = RemapNumbers(Value=pdecon.ZComponent, Source=bnd_3, Target=dom_5)  # -> Mapped, Clipped
scale = Scale(Geometry=ln, Center=curvepoint, Factor=remap_3.Mapped)  # -> Geometry, Transform
loft = Loft(Curves=scale.Geometry, Options={Adjust=False, Closed=False, LoftEnds=0, LoftSimp=0, LoftType=0, Rebuild=10, Refit=0.01})
offset = OffsetSurface(Surface=loft, Distance=Slider(0.44, range=0..1), Retrim=True)
