# Grasshopper definition grasshoppertuts.gh (Grasshopper 1.0.7)

crv = Curve(<curve referenced from the Rhino model>)
crv_2 = Curve(<curve referenced from the Rhino model>)
divide = DivideCurve(Curve=crv, Count=10, Kinks=False)  # -> Points, Tangents, Parameters
divide_2 = DivideCurve(Curve=crv_2, Count=Slider(10, range=0..10), Kinks=False)  # -> Points, Tangents, Parameters
cull = CullPattern(List=divide_2.Points, CullPattern=[True, False])
points = PointList(Points=divide_2.Points, Size=0.5)
points_2 = PointList(Points=divide.Points, Size=0.5)
panel = Panel(divide.Points)
panel_2 = Panel(divide_2.Points)
number_slider = Slider(3, range=0..10)
series = Series(Start=0, Step=number_slider, Count=10)
series_2 = Series(Start=0, Step=number_slider, Count=10)
series_3 = Series(Start=0, Step=number_slider, Count=10)
panel_3 = Panel(series_3)
panel_4 = Panel(series)
panel_5 = Panel(series_2)
ln = Line(StartPoint=panel, EndPoint=panel_2)
subset = SubList(List=ln, Wrap=True)  # -> List, Index
split = SplitList(List=ln, Index=Slider(8, range=0..10))  # -> ListA, ListB
item = ListItem(List=ln, Index=0, Wrap=True)
crossref = CrossReference(ListA=panel_4, ListB=panel_5, ListC=panel_3, CrossMode=1)  # -> ListA, ListB, ListC
crv_3 = Curve(split.ListB)
crv_4 = Curve(split.ListA)
pt = ConstructPoint(XCoordinate=crossref.ListA, YCoordinate=crossref.ListB, ZCoordinate=crossref.ListC)
